% Simulink data dictionary DD_State_Machine.sldd

Contact = enum(DefaultValue="Open", StorageType="int8")
  Init = 0
  Open = 1
  Close = 2

BMS_Configuration = Simulink.ConfigSet(StartTime="0", StopTime="10000", Solver="FixedStepDiscrete", ProdHWDeviceType="Intel->x86-64 (Linux 64)", SystemTargetFile="grt.tlc", TargetLang="C++")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
BMS_Sw_CodeGenConfig = Simulink.ConfigSet(StartTime="0", StopTime="9000", Solver="FixedStepDiscrete", ProdHWDeviceType="ARM Compatible->ARM Cortex-M", SystemTargetFile="ert.tlc", TargetLang="C")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

Faults = Simulink.Bus(HeaderFile="Rte_Type.h")
  VoltSensor: boolean
  OverCurrent: boolean
  HighTemp: boolean
  LowTemp: boolean
  OverVolt: boolean
  UnderVolt: boolean
  Charger: boolean
  Inverter: boolean

Contactors_Cmd = Simulink.Bus(HeaderFile="Rte_Type.h")
  PosContactorChgrCmd: boolean
  PreChargeRelayChgrCmd: boolean
  NegContactorChgrCmd: boolean
  PosContactorInvtrCmd: boolean
  PreChargeRelayInvtrCmd: boolean
  NegContactorInvtrCmd: boolean

BMS_Info = Simulink.Bus(HeaderFile="Rte_Type.h")
  Faults_Bus: Bus: Faults
  BMS_State: Enum: BMS_State_Enum
  SOC: Bus: SOC_Est

BMS_Cmd = Simulink.Bus(HeaderFile="Rte_Type.h")
  CurrentLimits_Bus: Bus: CurrentLimits
  ChargeCurrentReq: single, Unit="A"
  ContactorsCmd_Bus: Bus: Contactors_Cmd
  BalCmd: boolean[1 96]

CurrentLimits = Simulink.Bus(HeaderFile="Rte_Type.h")
  DischargeCurrentLimit: single, Unit="A"
  ChargeCurrentLimit: single, Unit="A"

Min_Max_Cells = Simulink.Bus(HeaderFile="Rte_Type.h")
  MinCellVolt: single, Min=0, Max=5, Unit="V"
  MaxCellVolt: single, Min=0, Max=5, Unit="V"
  MinCellTemp: single, Min=263.15, Max=333.15, Unit="K"
  MaxCellTemp: single, Min=263.15, Max=333.15, Unit="K"

BusObject1 = Simulink.Bus(HeaderFile="Rte_Type.h")

Sensors = Simulink.Bus(HeaderFile="Rte_Type.h")
  Cell_Voltages: single[96], Min=0, Max=5, Unit="V"
  Pack_Voltage: single, Min=0, Max=480, Unit="V"
  Pack_Current: single, Min=-100, Max=100, Unit="A"
  Cell_Temperatures: single[96], Min=-10, Max=40, Unit="degC"
  Vout_Chgr: single, Min=-500, Max=500, Unit="V"
  Vout_Invtr: single, Min=-500, Max=500, Unit="V"

BusObject = Simulink.Bus(HeaderFile="Rte_Type.h")

SOC_Est = Simulink.Bus(HeaderFile="Rte_Type.h")
  SOC_CC: single