% Simulink data dictionary Battery_16Packs_3RC.sldd

CellType = 2
Ns_Module = 6
Ns_Pack = 96
NumModules = 16

Battery = struct(
  SOC_LUT=[0.1348387; 0.2309677; 0.3270968; 0.4232258; 0.5193548; 0.6154839; 0.7116129; 0.8077419; 0.903871; 1],
  Temperature_LUT=[278.15 293.15 313.15],
  Capacity_LUT=[31 31 31],
  Em_LUT=[3.500575 3.529259 3.516864
   3.567865 3.573994 3.572803
   3.611847 3.623904 3.627713
   3.652765 3.661221 3.670499
   3.696307 3.70229 3.711918
   3.755084 3.758982 3.767075
   3.853693 3.866308 3.878365
   3.955898 3.965316 3.96637
   4.065079 4.070351 4.072833
   4.188907 4.191288 4.191332],
  R0_LUT=[0.009996904 0.007142829 0.006014603
   0.009904469 0.007829768 0.006496835
   0.009927099 0.008011358 0.007176989
   0.009318481 0.006960289 0.006984415
   0.009781122 0.007230269 0.007483559
   0.009550958 0.006570822 0.006292864
   0.009422805 0.007111507 0.006883348
   0.009866869 0.007040582 0.007262261
   0.009883586 0.006881958 0.006427372
   0.009997145 0.007438176 0.006895834],
  R1_LUT=[0.004922894 0.003521285 0.002792244
   0.004777153 0.002676239 0.003411986
   0.004255229 0.002149799 0.002725632
   0.00352053 0.00262699 0.002564222
   0.004086096 0.002763759 0.002184144
   0.003764125 0.002986309 0.003223863
   0.003793942 0.002664509 0.003096806
   0.003513614 0.002752562 0.002672058
   0.003923104 0.00308971 0.003181728
   0.00303491 0.002389365 0.002822787],
  C1_LUT=[153.1652 611.6189 103.0471
   2964.004 5583.303 1835.578
   5696.546 9020.084 4505.19
   461.3957 2247.969 2087.613
   6452.862 4824.148 4406.588
   3814.12 1626.413 2678.829
   1509.367 3260.982 950.5193
   3415.324 2162.103 4577.181
   1691.913 1401.433 2542.503
   3799.494 3888.962 3259.476],
  cell_mass=0.84,
  cell_rho_Cp=2040000,
  cell_Cp_heat=964.92,
  T_init=288.15,
  Qe_init=7.75,
  R2_LUT=[0.003781491 0.001972772 0.0007711144
   0.004949411 0.00187122 0.0008298184
   0.00149699 0.0009680358 0.0004252961
   0.002883128 0.00175312 0.0005069804
   0.001654024 0.001606029 0.001656735
   0.0001162151 0.0002052842 0.0001459861
   0.001760344 0.00161587 0.001868596
   0.001500501 0.001606184 0.0006821501
   0.001040328 0.000985456 0.0003909651
   0.001836556 0.005050219 0.001370372],
  R3_LUT=[0.003534854 0.0006652551 0.00137885
   0.001002744 0.0006652551 0.0004136972
   0.0001373396 0.0001476871 4.425592e-05
   0.001697973 0.001240498 0.001773003
   0.00122299 0.001044615 0.001189372
   0.0001327472 8.727375e-05 0.0001085452
   0.00305794 0.006803457 0.003395135
   0.001609894 0.01569497 6.111815e-05
   0.0003543103 0.02391248 5.647548e-05
   0.002424929 0.009781512 0.001083363],
  C2_LUT=[21645.96 88989.2 323644.2
   100402.6 297453.8 730803.6
   250224.2 531076.6 865698.8
   38897.96 90971.02 91999.1
   165265.7 322671.7 470442.8
   326351 1916866 487626.3
   581364.6 662092.2 616059
   210286.7 149542.8 461280.4
   428008.5 516820.8 749769.9
   563384 2254852 681074.4],
  C3_LUT=[1951.588 100318.2 4674.865
   37934.27 5338624 312568.7
   246284.6 8158741 625155.2
   486350.5 4264847 994865
   426912.1 5441544 614746.7
   709364.8 690315.2 809807.8
   563149.1 2666057 650151.9
   574703.5 2601605 493753.2
   489706.8 2289570 647747.9
   612075.7 3322135 717990.1],
  cell_area=0.1019,
  h_conv=5,
  R_bleed=20,
  TempInit=288.15)

CurrentLimits = Simulink.Bus(HeaderFile="Rte_Type.h")
  DischargeCurrentLimit: single
  ChargeCurrentLimit: single

Contactors_Cmd = Simulink.Bus(HeaderFile="Rte_Type.h")
  PosContactorChgrCmd: boolean
  PreChargeRelayChgrCmd: boolean
  NegContactorChgrCmd: boolean
  PosContactorInvtrCmd: boolean
  PreChargeRelayInvtrCmd: boolean
  NegContactorInvtrCmd: boolean

Sensors = Simulink.Bus(HeaderFile="Rte_Type.h")
  Cell_Voltages: single[96]
  Pack_Voltage: single
  Pack_Current: single
  Vout_Chgr: single
  Vout_Invtr: single
  Cell_Temperatures: single[96]

BMS_Cmd = Simulink.Bus(HeaderFile="Rte_Type.h")
  CurrentLimits: Bus: CurrentLimits
  ChargeCurrentReq: single
  Contactors_Cmd: Bus: Contactor_Commands
  BalCmd: boolean[1 96]