% Simulink data dictionary Battery_32Packs_1RC.sldd

CellType = 1
Ns_Module = 6

Battery = struct(
  SOC_LUT=[0.1378189; 0.2336168; 0.3294147; 0.4252126; 0.5210105; 0.6168084; 0.7126063; 0.8084042; 0.9042021; 1],
  Temperature_LUT=[278.15 293.15 323.15],
  Capacity_LUT=[31 31 31],
  Em_LUT=[3.495876 3.513261 3.515929
   3.558586 3.571954 3.572374
   3.607242 3.620683 3.627655
   3.647712 3.6576 3.666113
   3.693146 3.69761 3.706816
   3.755492 3.757733 3.766967
   3.841654 3.850835 3.866459
   3.951051 3.957725 3.966174
   4.063666 4.067089 4.072363
   4.190652 4.190612 4.191672],
  R0_LUT=[0.009999981 0.009693751 0.007081459
   0.009998564 0.009112391 0.007873589
   0.009987303 0.008946325 0.008371746
   0.009962629 0.008794302 0.00835611
   0.009872754 0.008370281 0.008207898
   0.009995431 0.007966578 0.007837292
   0.009901997 0.008293178 0.008431849
   0.009947531 0.008462239 0.008577474
   0.009888643 0.008600463 0.007838093
   0.009935466 0.008694306 0.007610306],
  R1_LUT=[0.004999478 0.001764148 0.003164036
   0.0049952 0.0018232 0.002227583
   0.004979423 0.002156026 0.001985157
   0.004981172 0.001900603 0.001830198
   0.004509405 0.001789879 0.001838038
   0.00398128 0.001918548 0.002074314
   0.003766915 0.001880084 0.001986724
   0.004191636 0.002144337 0.001619022
   0.00442604 0.001552468 0.002110344
   0.004314838 0.001549708 0.002187277],
  C1_LUT=[1983.385 78841.49 1101.576
   4685.295 46429.68 4135.528
   9956.775 63356.41 12730.6
   11168.87 44437.72 12079.47
   4241.754 25121.86 9873.972
   4860.185 15430.16 2313.843
   8563.329 19567.71 8773.596
   11272.46 21732.15 11126.47
   3899.653 15798.99 2546.168
   2937.385 42171.32 1720.829],
  cell_mass=0.84,
  cell_rho_Cp=2040000,
  cell_Cp_heat=964.92,
  T_init=288.15,
  Qe_init=7.75,
  cell_area=0.101908,
  h_conv=5,
  R_bleed=20,
  TempInit=288.15,
  SOCInit=[0.75 0.75 0.75 0.75 0.78 0.72])

NumModules = 32

CurrentLimits = Simulink.Bus(HeaderFile="Rte_Type.h")
  DischargeCurrentLimit: single
  ChargeCurrentLimit: single

Contactors_Cmd = Simulink.Bus(HeaderFile="Rte_Type.h")
  PosContactorChgrCmd: boolean
  PreChargeRelayChgrCmd: boolean
  NegContactorChgrCmd: boolean
  PosContactorInvtrCmd: boolean
  PreChargeRelayInvtrCmd: boolean
  NegContactorInvtrCmd: boolean

BMS_Cmd = Simulink.Bus(HeaderFile="Rte_Type.h")
  CurrentLimits_Bus: Bus: CurrentLimits
  ChargeCurrentReq: single
  ContactorsCmd_Bus: Bus: Contactors_Cmd
  BalCmd: boolean[1 192]

Sensors = Simulink.Bus(HeaderFile="Rte_Type.h")
  Cell_Voltages: single[192]
  Pack_Voltage: single
  Pack_Current: single
  Cell_Temperatures: single[192]
  Vout_Chgr: single
  Vout_Invtr: single